# Grasshopper definition 01_ellipse-ui.gh (Grasshopper 1.0.8)
# plug-ins: Human

# ---- group: UI
# Hello there!
rad_1 = Slider(5, range=1..10)
rad_2 = Slider(2, range=1..10)
point = Point(Point(0, 0, 0))

# ----
panel = Panel("Hello there")
ellipse = Ellipse(Plane=point, Radius1=rad_1, Radius2=rad_2)  # -> Ellipse, Focus1, Focus2
bake_geometry = BakeGeometry(Bake=invert(False), Geometry=ellipse.Ellipse, DeleteOldBakes=True, PreserveTrees=False)
