# Grasshopper definition 02b_Canton Tower_Better.gh (Grasshopper 1.0.8)

# ---- group: UI_Tower Inputs
major_column_diameter_mm = Slider(856, range=0..2000, expression="x/1000")
number_columns = Slider(40, range=3..50)
panel = Panel("Column Parameters")
column_offset = Slider(4, range=0..10)
minor_major_column_ratio = Slider(2.681, range=1..5)

panel_2 = Panel("Render Options")
pipe_columns = BooleanToggle(True)
tower_name = Text("Your Name Here!")

tower_height_m = Slider(422, range=0..1000)
# Twisty Tower Script!
panel_3 = Panel("Tower Parameters")
ellipse_major_radius_m = Slider(25, range=0..100)
rotation_angle_deg = Slider(60, range=0..180)
ellipse_minor_radius_m = Slider(49, range=0..100)
storey_height_m = Slider(10, range=0..10)

# ----
ellipse = Ellipse(Plane=PlaneXY(0, 0, 0), Radius1=ellipse_major_radius_m, Radius2=ellipse_minor_radius_m)  # -> Ellipse, Focus1, Focus2
construct_point = ConstructPoint(XCoordinate=ellipse_minor_radius_m, YCoordinate=0, ZCoordinate=0)
division = Division(A=tower_height_m, B=storey_height_m)
unit_z = UnitZ(Factor=tower_height_m)
curve = Curve(ellipse.Ellipse)
integer = Integer(division)
text_tag_3d = TextTag3D(Location=construct_point, Text=tower_name, Size=50, Justification=7)
division_2 = Division(A=tower_height_m, B=integer)
move = Move(Geometry=curve, Motion=unit_z)  # -> Geometry, Transform
unit_z_2 = UnitZ(Factor=division_2)
xy_plane = XYPlane(Origin=Point(0, 0, 0))
rotate = Rotate(Geometry=move.Geometry, Angle=degrees(rotation_angle_deg), Plane=PlaneXY(0, 0, 0))  # -> Geometry, Transform
linear_array = LinearArray(Geometry=xy_plane, Direction=unit_z_2, Count=expr("x+1", integer))  # -> Geometry, Transform
entwine = Entwine(Branch00=curve, Branch01=rotate.Geometry, FlattenInputs=True)
divide_curve = DivideCurve(Curve=entwine, Count=number_columns, Kinks=False)  # -> Points, Tangents, Parameters
explode_tree = ExplodeTree(Data=divide_curve.Points)  # -> Branch0, Branch1
shift_list = ShiftList(List=explode_tree.Branch1, Shift=column_offset, Wrap=True)
line = Line(StartPoint=explode_tree.Branch0, EndPoint=shift_list)
stream_filter = StreamFilter(Gate=pipe_columns, Stream1=line)
curve_plane = CurvePlane(Curve=line, Plane=simplify(graft(linear_array.Geometry)))  # -> simplify(Points), ParamsC, ParamsP
shift_paths = ShiftPaths(Data=curve_plane.Points, Offset=-1)
pipe = Pipe(Curve=stream_filter, Radius=major_column_diameter_mm, Caps=0)
tree_statistics = TreeStatistics(Tree=shift_paths)  # -> Paths, Length, Count
polyline = PolyLine(Vertices=shift_paths, Closed=True)
deconstruct_path = DeconstructPath(Branch=tree_statistics.Paths)  # -> simplify(Indices)
boundary_surfaces = BoundarySurfaces(Edges=polyline)
shift_list_2 = ShiftList(List=shift_paths, Shift=expr("-x", deconstruct_path), Wrap=True)
flip_matrix = FlipMatrix(Data=shift_list_2)
polyline_2 = PolyLine(Vertices=flip_matrix, Closed=False)  # -> flatten(Polyline)
explode = Explode(Curve=polyline_2, Recursive=True)  # -> Segments, Vertices
division_3 = Division(A=major_column_diameter_mm, B=minor_major_column_ratio)
stream_filter_2 = StreamFilter(Gate=pipe_columns, Stream1=explode.Segments)
pipe_2 = Pipe(Curve=stream_filter_2, Radius=division_3, Caps=0)
