# Grasshopper definition 20250412_groupNestingTest.gh (Grasshopper 1.0.8)
# plug-ins: ghfe Info

# ---- group: UI_
main_slider_a = Slider(0.25, range=0..1)
ok = Button()
small_slider = Slider(0.25, range=0..1)
label = Panel("Test label.")
help = Button()
main_slider_b = Slider(0.25, range=0..1)
cancel = Button()

# ---- group: Subsection 1
# LABEL: Toggle this to become sad.
be_sad = BooleanToggle(False)
ratio = Slider(0.3, range=-3..6)
size = Slider(1, range=-39..3)

# ---- group: Subsection 2-1
awesomeness = Slider(4.682, range=0..15)
slider = Slider(0, range=-5..21)

# ---- group: UI_ / Subsection 2
# LABEL2: This is a nested subsection
be_awesome = BooleanToggle(True)

# ----
trigger = Trigger(Interval=500, TimerInterval=500, Target=visualize_hierarchy)  # disabled
visualize_hierarchy = VisualizeHierarchy(GroupName="UI")
panel = Panel(visualize_hierarchy)
