# Grasshopper definition 20250412_test scrupt.gh (Grasshopper 1.0.8)
# plug-ins: ghfe Info

# ---- group: UI_
main_slider_a = Slider(0.25, range=0..1)
main_slider_b = Slider(0.476, range=0..1)
main_slider_b_2 = Slider(0.25, range=0..1)

number_slider = Slider(0.25, range=0..1)
boolean_toggle = BooleanToggle(False)
number_slider_2 = Slider(0.25, range=0..1)

# ----
button = Button()

boolean_toggle_2 = BooleanToggle(False)
main_slider_b_3 = Slider(0.283, range=0..1)
boolean_toggle_3 = BooleanToggle(False)

main_slider_b_4 = Slider(0.283, range=0..1)
main_slider_b_5 = Slider(0.283, range=0..1)

button_2 = Button()
button_3 = Button()
trigger = Trigger(Interval=500, TimerInterval=500, Target=[visualize_hierarchy, visualize_hierarchy_2])  # disabled
visualize_hierarchy = VisualizeHierarchy(GroupName="UI")
visualize_hierarchy_2 = VisualizeHierarchy(GroupName="UI", Origin=Point(0, 0, 0), Width=100, RowHeight=Slider(10, range=1..30), Indent=10)  # -> Outlines, Labels, Margins
panel = Panel(visualize_hierarchy)
area = Area(Geometry=visualize_hierarchy_2.Outlines)  # -> Area, Centroid
extend_curve = ExtendCurve(Curve=visualize_hierarchy_2.Margins, Type=0, Start="-5", End="-5")
fillet = Fillet(Curve=visualize_hierarchy_2.Outlines, Radius="3")
pipe = Pipe(Curve=extend_curve, Radius="0.5", Caps=2)
offset_curve = OffsetCurve(Curve=extend_curve, Distance=1, Corners=2)
text_tag_3d = TextTag3D(Location=area.Centroid, Text=visualize_hierarchy_2.Labels, Size=1, Justification=5)
scale = Scale(Geometry=fillet, Center=area.Centroid, Factor="0.95")  # -> Geometry, Transform
