# Grasshopper definition Ship Resize.gh (Grasshopper 1.0.8)

# ---- group: UI
width = Slider(0.5, range=0.5..1.5)
length = Slider(0.5, range=0.5..1.5)
height = Slider(0.5, range=0.5..1.5)

# ----
brep = Brep(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)
xy_plane = XYPlane(Origin=Point(114.6308117, -0.01511867199, 10.79772481))
scale_nu = ScaleNU(Geometry=brep, Plane=xy_plane, ScaleX=length, ScaleY=width, ScaleZ=height)  # -> Geometry, Transform
